% Simulink data dictionary BallAndPlate_system_data.sldd
% references BallAndPlate_variant_data.sldd

ball_mass = Simulink.Parameter(1, Unit="kg")
ball_radius = Simulink.Parameter(1, Unit="cm")

Bus_pos = Simulink.Bus()
  x: double
  y: double

Bus_angle = Simulink.Bus()
  x: double
  y: double

Param = Simulink.Parameter([])
FRE_freq_vec_20 = [1 1.274275 1.623777 2.069138 2.636651 3.359818 4.281332 5.455595 6.951928 8.858668 11.28838 14.3845 18.32981 23.35721 29.76351 37.9269 48.3293 61.58482 78.476 100]
TimeStep_PID_slow = Simulink.Parameter(0.01)
TimeStep_PID_fast = Simulink.Parameter(0.002)
FRE_amplitude = Simulink.Parameter(2)
TimeStep_MPC = Simulink.Parameter(0.02)
motor_shaft_mu_2 = Simulink.Parameter(0, Unit="N*m/(deg/s)")
step_interval_time = Simulink.Parameter(5, Unit="s")
step_delay_time = Simulink.Parameter(2, Unit="s")
EKF_P_init = Simulink.Parameter(Simulink.data.Expression(ExpressionString="eye(EKF_x_num)"))
EKF_x_init = Simulink.Parameter(Simulink.data.Expression(ExpressionString="zeros(EKF_x_num, 1)"))
EKF_R = Simulink.Parameter(Simulink.data.Expression(ExpressionString="eye(EKF_y_num)"))
EKF_Q = Simulink.Parameter(Simulink.data.Expression(ExpressionString="eye(EKF_x_num)"))
ref_pos_length = Simulink.Parameter(5, Unit="cm")
circile_ref_amplitude = Simulink.Parameter(4, Unit="cm")
RLS_adaptive_gain = Simulink.Parameter(1.0e-8)
circile_ref_frequency = Simulink.Parameter(0.5, Unit="Hz")
normal_ref_num = Simulink.Parameter(1)

V_TimeStep = Simulink.VariantVariable(
  struct(
    Choices=[struct(Condition="SIMMODE_MPC_A", Value="TimeStep_MPC"), struct(Condition="SIMMODE_MPC_ARLS", Value="TimeStep_MPC"), struct(Condition="SIMMODE_MPC_ARLS_TR", Value="TimeStep_MPC"), struct(Condition="SIMMODE_MPC_A_TR", Value="TimeStep_MPC"), struct(Condition="SIMMODE_PID_CHECK_TF", Value="TimeStep_PID_slow"), struct(Condition="SIMMODE_PID_CIRCLE", Value="TimeStep_PID_slow"), struct(Condition="SIMMODE_PID_FRE", Value="TimeStep_PID_fast"), struct(Condition="SIMMODE_PID_STEP", Value="TimeStep_PID_slow")],
    Specification=[]))

V_refNum = Simulink.VariantVariable(
  struct(
    Choices=[struct(Condition="SIMMODE_MPC_A", Value="normal_ref_num"), struct(Condition="SIMMODE_MPC_ARLS", Value="normal_ref_num"), struct(Condition="SIMMODE_MPC_ARLS_TR", Value="MPC_PredictionHorizon"), struct(Condition="SIMMODE_MPC_A_TR", Value="MPC_PredictionHorizon"), struct(Condition="SIMMODE_PID_CHECK_TF", Value="normal_ref_num"), struct(Condition="SIMMODE_PID_CIRCLE", Value="normal_ref_num"), struct(Condition="SIMMODE_PID_FRE", Value="normal_ref_num"), struct(Condition="SIMMODE_PID_STEP", Value="normal_ref_num")],
    Specification=[]))

controller_config_MPC_PIL = Simulink.ConfigSet(StartTime="0", StopTime="10", FixedStep="TimeStep_MPC", Solver="FixedStepDiscrete", ProdHWDeviceType="ARM Compatible->ARM Cortex", SystemTargetFile="ert.tlc", HardwareBoard="STM32 Nucleo H743ZI2", TargetLang="C")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
controller_config_MPC = Simulink.ConfigSet(StartTime="0", StopTime="10", FixedStep="TimeStep_MPC", Solver="FixedStepDiscrete", ProdHWDeviceType="Intel->x86-64 (Windows64)", SystemTargetFile="ert.tlc", TargetLang="C")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
D_gain_filter_N = Simulink.Parameter(100)
Kp_x = Simulink.Parameter(2.5)
Kp_y = Simulink.Parameter(2.5)
Kd_x = Simulink.Parameter(2)
Kd_y = Simulink.Parameter(2)
Kd_x_delay = Simulink.Parameter(1.2)
Kp_x_delay = Simulink.Parameter(1)
Kd_y_delay = Simulink.Parameter(1.2)
Kp_y_delay = Simulink.Parameter(1)

V_Kp_x = Simulink.VariantVariable(
  struct(
    Choices=[struct(Condition="DELAYMODE_OFF", Value="Kp_x"), struct(Condition="DELAYMODE_ON", Value="Kp_x_delay")],
    Specification=[]))

V_Kp_y = Simulink.VariantVariable(
  struct(
    Choices=[struct(Condition="DELAYMODE_OFF", Value="Kp_y"), struct(Condition="DELAYMODE_ON", Value="Kp_y_delay")],
    Specification=[]))

V_Kd_y = Simulink.VariantVariable(
  struct(
    Choices=[struct(Condition="DELAYMODE_OFF", Value="Kd_y"), struct(Condition="DELAYMODE_ON", Value="Kd_y_delay")],
    Specification=[]))

V_Kd_x = Simulink.VariantVariable(
  struct(
    Choices=[struct(Condition="DELAYMODE_OFF", Value="Kd_x"), struct(Condition="DELAYMODE_ON", Value="Kd_x_delay")],
    Specification=[]))

StopTime = Simulink.Parameter(11.99)
motor_shaft_mu_1 = Simulink.Parameter(0, Unit="N*m/(deg/s)")
offset_free_I_gain = Simulink.Parameter(0)
EKF_x_num = Simulink.Parameter(8)
EKF_u_num = Simulink.Parameter(2)
EKF_y_num = Simulink.Parameter(2)
MPC_PredictionHorizon = Simulink.Parameter(60)
angle_signal_transport_delay_time = Simulink.Parameter(0.2, Unit="s")