% Simulink data dictionary BallAndPlate_variant_data.sldd

SIMMODE_PID_FRE = Simulink.Variant(Condition="SIMMODE == ENUM_SIMMODE.PID_FRE")
SIMMODE_PID_STEP = Simulink.Variant(Condition="SIMMODE == ENUM_SIMMODE.PID_STEP")
SIMMODE_PID_CIRCLE = Simulink.Variant(Condition="SIMMODE == ENUM_SIMMODE.PID_CIRCLE")
SIMMODE_MPC = Simulink.Variant(Condition="SIMMODE == ENUM_SIMMODE.MPC")
SIMMODE_PID_CHECK_TF = Simulink.Variant(Condition="SIMMODE == ENUM_SIMMODE.PID_CHECK_TF")
SIMMODE_MPC_A = Simulink.Variant(Condition="SIMMODE == ENUM_SIMMODE.MPC_A")
SIMMODE_MPC_ARLS = Simulink.Variant(Condition="SIMMODE == ENUM_SIMMODE.MPC_ARLS")
SIMMODE_MPC_A_TR = Simulink.Variant(Condition="SIMMODE == ENUM_SIMMODE.MPC_A_TR")

ENUM_SIMMODE = enum(DefaultValue="PID_STEP", StorageType="int8")
  PID_STEP = 0
  PID_CIRCLE = 1
  PID_FRE = 2
  PID_CHECK_TF = 3
  MPC_A = 4
  MPC_ARLS = 5
  MPC_A_TR = 6
  MPC_ARLS_TR = 7

SIMMODE_MPC_ARLS_TR = Simulink.Variant(Condition="SIMMODE == ENUM_SIMMODE.MPC_ARLS_TR")

DELAYMODE = Simulink.VariantControl(
  Value=Simulink.Parameter(
    Value=Simulink.data.Expression(ExpressionString="ENUM_DELAYMODE.OFF"),
    StorageClass="CompilerFlag",
    DataType="int8"),
  ActivationTime="update diagram",
  ValueType="Simulink.Parameter")

DELAYMODE_OFF = Simulink.Variant(Condition="DELAYMODE == ENUM_DELAYMODE.OFF")
DELAYMODE_ON = Simulink.Variant(Condition="DELAYMODE == ENUM_DELAYMODE.ON")

SIMMODE = Simulink.VariantControl(
  Value=Simulink.Parameter(
    Value=Simulink.data.Expression(ExpressionString="ENUM_SIMMODE.PID_STEP"),
    StorageClass="CompilerFlag",
    DataType="int8"),
  ActivationTime="update diagram",
  ValueType="Simulink.Parameter")

ENUM_DELAYMODE = enum(DefaultValue="OFF", StorageType="int8")
  OFF = 0
  ON = 1